# Requirement set stakeholderRequirements (R2023a)

## 1 [STAKEHOLDER_08] Flight maneuver
The drone shall be able to perform take off and landing vertically.

## 2 [STAKEHOLDER_11] Package
The drone can carry a package with a mass of at least 10 grams.

## 3 [STAKEHOLDER_12] Package
The drone can attach and release a package without human intervention.

## 4 [STAKEHOLDER_09] Maneuverability
The drone should be able to move freely in all 6 directions.

## 5 [STAKEHOLDER_10] Maneuverability
The drone can freely rotate along the Z-axis whilst stationery.

## 6 [STAKEHOLDER_03] Control
The drone can be controlled remotely.

## 7 [STAKEHOLDER_04] Control
The drone can be controlled autonomously.

### 7.1 [STAKEHOLDER_05] Autonomy
Whilst flying autonously, the drone can avoid obstacles.

### 7.2 [STAKEHOLDER_06] Landing accuracy
The drone can land autonomously with an accuracy of 1 meter.

## 8 [STAKEHOLDER_13] Performance
The drone can fly at a height of at least 2 meters.

## 9 [STAKEHOLDER_01] Communication
The drone can send telemetry to a remote controller.

## 10 [STAKEHOLDER_14] Performance
The drone shall have a flight range of at least 10 meters.

## 11 [STAKEHOLDER_02] Communication
The drone can remain in contact with the remote controller at an unobstructed distance of at least 10 meters.

## 12 [STAKEHOLDER_15] Safety
The drone can autonously shut down when dangerous conditions are sensed.

## 13 [STAKEHOLDER_07] Drone platform
The For The Win Robotics Parrot Mambo drone has to be used.