# Requirement set systemRequirements (R2023a)

## 1 [SENS_01] Zone detection
The camera sensor can detect a 10 cm wide green mark when within the cameras field of vision.

## 2 [CONTROL_04] Positioning
The drone can be positioned whilst in the air within 1 meter horizontally of a green mark.

## 3 [CONTROL_05] Obstacle avoidance
If an obstacle is detected underneath the drone in the landing zone, the drone will move in the direction of the marker until the obstacle is cleared.

## 4 [CONTROL_06] Landing autonomous
The drone can land autonomously after hovering over the landing zone and being clear of obstacles.

## 5 [CONTROL_07] Emergency Shutdown
The drone will autonomously stop the motors after a collision.

## 6 [GRABBER_01] Grabber manual control
The grabber can be engaged and disengaged manually.

## 7 [GRABBER_02] Grabber autonomous control
The grabber can be engaged autonomously before initial takeoff.

## 8 [GRABBER_04] Grabber capacity
The grabber can carry an object with a mass of 10 grams.

## 9 [GRABBER_03] Grabber autonomous control
The grabber can be disengaged autonomously after landing at the drop off site.

## 10 [CONTROL_01] Liftoff autonomous
The drone can liftoff autonomously after engaging the grabber at the pickup point.

## 11 [CONTROL_02] Liftoff autonomous
The drone can liftoff autonomously after disengaging the grabber at the dropoff point.

## 12 [CONTROL_03] Zone detection
The drone will fly up vertically until the landing zone is detected or the flight ceiling is reached.

## 13 [SENS_02] Obstacle detection
Red obstacles directly underneath the drone are detected.

## 14 [CONTROL_08] Nominal Shutdown
The drone will shutdown after completing the delivery (landed back at the pickup point).